# Dynamo graph TG_Checker.dyn (Dynamo 1.3.4.6666)

prefix = StringInput(" \n")
prefix_2 = StringInput("TG")

# group: Check
prefix_3 = BoolSelector(false)
groups = BoolSelector(false)
unused_linestyles = BoolSelector(false)
rooms = BoolSelector(false)
warnings = BoolSelector(false)
exterior_walls = BoolSelector(false)
stairs_formula = BoolSelector(false)
stairs_head_height = BoolSelector(false)

prefix_4 = Python(IN[0]=prefix_2, IN[1]=prefix_3)
# ---------- prefix_4.python (69 lines) ----------
import clr
clr.AddReference('RevitServices')
import RevitServices
from RevitServices.Persistence import DocumentManager
from RevitServices.Transactions import TransactionManager

clr.AddReference('RevitAPI')

import Autodesk
from Autodesk.Revit.DB import *
from Autodesk.Revit.DB import FilteredElementCollector
from Autodesk.Revit.DB.Architecture import *

doc = DocumentManager.Instance.CurrentDBDocument

prefix = IN[0]
condition = IN[1]

def Checking(class_name):
	global prefix
	count = 0
	elements = FilteredElementCollector(doc).OfClass(class_name).ToElements()
	for i in elements:
		i_name = Element.Name.GetValue(i).ToString()
		if not i_name.startswith(prefix):
			count += 1
	return count

if condition:
	count = 0
	#  Loadable families
	count += Checking(Family)
	
	#  System architecture families
	count += Checking(WallType)
	count += Checking(WallFoundationType)
	count += Checking(RoofType)
	count += Checking(FasciaType)
	count += Checking(GutterType)
	count += Checking(CeilingType)
	count += Checking(CurtainSystemType)
	count += Checking(PanelType)
	count += Checking(ContinuousRailType)
	count += Checking(StairsType)
	count += Checking(StairsRunType)
	count += Checking(StairsLandingType)
	count += Checking(AreaScheme)
	count += Checking(LevelType)
	count += Checking(GridType)
	
	#  System annotate families
	count += Checking(DimensionType)
	count += Checking(SpotDimensionType)
	count += Checking(FilledRegionType)
	count += Checking(TextNoteType)
	
	#  System landscape families
	count += Checking(BuildingPadType)
	
	#  Other
	count += Checking(BrowserOrganization)
	count += Checking(LinePatternElement)
	count += Checking(GroupType)
	count += Checking(ViewSchedule)
	
	OUT = str(count) + " elements without correct prefix"
	
else:
	OUT = "Prefix check is off."
# ----------------------------------------
groups_2 = Python(IN[0]=groups)
# ---------- groups_2.python (63 lines) ----------
import clr

clr.AddReference("RevitServices")
import RevitServices
from RevitServices.Persistence import DocumentManager

clr.AddReference("RevitAPI")
import Autodesk
from Autodesk.Revit.DB import *

doc = DocumentManager.Instance.CurrentDBDocument

condition = IN[0]

grouptypes = FilteredElementCollector(doc).OfClass(GroupType).ToElements()
groups = FilteredElementCollector(doc).OfClass(Group).ToElements()

if condition:
	count_unused = 0
	count_unpinned = 0
	count_excluded = 0
	for i in grouptypes:
		#  Check size of GroupSet which given from GroupType
		if i.Groups.Size == 0:
			count_unused += 1
	for i in groups:
		#  Check for unpinned groups
		if not i.Pinned:
			count_unpinned += 1
		#  Check if group has excluded elements
		if i.Name.endswith("(members excluded)"):
			count_excluded += 1
	
	#  Output formatting
	result = ""
	if count_unused:
		result += str(count_unused)
		result += " of "
		result += str(len(groups))
		result += " groups are not used."
	if count_unpinned:
		if result:
			result += " "
		result += str(count_unpinned)
		result += " of "
		result += str(len(groups))
		result += " group instances are not pinned."
	if count_excluded:
		if result:
			result += " "
		result += str(count_excluded)
		result += " of "
		result += str(len(groups))
		result += " group instances are with excluded elements."
	
	#  Output
	if result:
		OUT = result
	else:
		OUT = "Groups are OK."
	
else:
	OUT = "Groups check is off."
# ----------------------------------------
unused_linestyles_2 = Python(IN[0]=unused_linestyles)
# ---------- unused_linestyles_2.python (53 lines) ----------
import clr
clr.AddReference('ProtoGeometry')
from Autodesk.DesignScript.Geometry import *
clr.AddReference("RevitNodes")
import Revit
clr.ImportExtensions(Revit.Elements)
clr.ImportExtensions(Revit.GeometryConversion)
clr.AddReference("RevitServices")
import RevitServices
from RevitServices.Persistence import DocumentManager
from RevitServices.Transactions import TransactionManager
from System.Collections.Generic import *

clr.AddReference("RevitAPI")
import Autodesk
from Autodesk.Revit.DB import *
doc = DocumentManager.Instance.CurrentDBDocument
uiapp = DocumentManager.Instance.CurrentUIApplication
app = uiapp.Application
uidoc=DocumentManager.Instance.CurrentUIApplication.ActiveUIDocument

condition = IN[0]

if condition:
	#  Selecting used line styles in a project
	lines_used = FilteredElementCollector(doc).OfCategory(BuiltInCategory.OST_Lines).WhereElementIsNotElementType().ToElements()
	line_styles_used = []
	for i in lines_used:
		line_style = i.LineStyle.Id #!!!!!!
		if not line_style in line_styles_used:
			line_styles_used.append(line_style)

	#  Selecting all line styles in the project
	line_styles_all = doc.Settings.Categories.get_Item(BuiltInCategory.OST_Lines).SubCategories
	line_styles = [i.Id for i in line_styles_all]

	TransactionManager.Instance.EnsureInTransaction(doc)

	count = 0
	for i in line_styles:
		if not i in line_styles_used:
			try:
				#doc.Delete(i)
				count += 1
			except:
				pass

	TransactionManager.Instance.TransactionTaskDone()

	OUT = str(count) + " line styles are unused"

else:
	OUT = "Unused linestyles check is off."
# ----------------------------------------
rooms_2 = Python(IN[0]=rooms)
# ---------- rooms_2.python (44 lines) ----------
import clr

clr.AddReference("RevitServices")
import RevitServices
from RevitServices.Persistence import DocumentManager

clr.AddReference("RevitAPI")
import Autodesk
from Autodesk.Revit.DB import *
from Autodesk.Revit.DB.Architecture import RoomFilter

doc = DocumentManager.Instance.CurrentDBDocument

condition = IN[0]

filter = RoomFilter()
rooms = FilteredElementCollector(doc).WherePasses(filter).ToElements()
opt = Options()
#opt.View = doc.ActiveView

if condition:
	count_p = 0
	count_i = 0
	solids = []
	for i in rooms:
		if i.Location is None:
			count_p += 1
		else:
			#  Checking for volumes overlap
			for obj in i.get_Geometry(opt):
				if  "Autodesk.Revit.DB.Solid" in str(obj):
					for s in solids:
						inter = BooleanOperationsUtils.ExecuteBooleanOperation(obj,s, BooleanOperationsType.Intersect)
						if inter.Volume:
							count_i += 1
					solids.append(obj)
	
	if count_p or count_i:
		OUT = str(count_p) + " rooms are not placed and " + str(count_i) + " of rooms volumes overlap."
	else:
		OUT = "Rooms are OK."
	
else:
	OUT = "Rooms check is off."
# ----------------------------------------
warnings_2 = Python(IN[0]=warnings)
# ---------- warnings_2.python (20 lines) ----------
import clr

clr.AddReference("RevitServices")
import RevitServices
from RevitServices.Persistence import DocumentManager

clr.AddReference("RevitAPI")
import Autodesk
from Autodesk.Revit.DB import *

doc = DocumentManager.Instance.CurrentDBDocument

condition = IN[0]

warnings = []
if condition:
	warnings = doc.GetWarnings()
	OUT = str(len(warnings)) + " warnings in the project"
else:
	OUT = "Warnings check is off."
# ----------------------------------------
exterior_walls_2 = Python(IN[0]=exterior_walls)
# ---------- exterior_walls_2.python (92 lines) ----------
import clr

clr.AddReference("RevitServices")
import RevitServices
from RevitServices.Persistence import DocumentManager
from RevitServices.Transactions import TransactionManager

clr.AddReference("RevitAPI")
import Autodesk
from Autodesk.Revit.DB import *
from Autodesk.Revit.Creation import Document as Doc

doc = DocumentManager.Instance.CurrentDBDocument

condition = IN[0]

if condition:
	v = FilteredElementCollector(doc).OfClass(View3D).ToElements()[0]
	id = v.GetTypeId()
	
	TransactionManager.Instance.EnsureInTransaction(doc)
	
	view = View3D.CreateIsometric(doc, id)
	box = view.GetSectionBox() #!!! CHECK !!!
	
	# Get perimeter points and lines
	p1 = box.Min
	p2 = XYZ(box.Min.X, box.Max.Y, box.Min.Z)
	p3 = XYZ(box.Max.X, box.Max.Y, box.Min.Z)
	p4 = XYZ(box.Max.X, box.Min.Y, box.Min.Z)
	curve = [Line.CreateBound(p1, p2), Line.CreateBound(p2, p3), Line.CreateBound(p3, p4), Line.CreateBound(p4, p1)]
	
	# Get the lowest level
	levels = FilteredElementCollector(doc).OfClass(Level).ToElements()
	elev = levels[0].Elevation
	for i in levels:
		if i.Elevation < elev:
			level = i
			elev = i.Elevation
	level_id = level.Id
	
	# Create perimeter walls
	w = []
	for i in curve:
		w.append(Wall.Create(doc, i, level_id, False))

	for i in w:
		p = i.get_Parameter(BuiltInParameter.WALL_TOP_OFFSET)
		p.Set(1000)
	
	# Create room
	point = UV(box.Min.X + 10, box.Min.Y + 10)
	room = doc.Create.NewRoom(level, point)
	
	TransactionManager.Instance.TransactionTaskDone()
	
	# Get outer walls
	walls = []
	segments = room.GetBoundarySegments(SpatialElementBoundaryOptions())
	for i in segments:
		for j in i:
			element = doc.GetElement(j.ElementId)
			try:
				if element.Category.Name == "Walls":
					walls.append(element)
			except:
				pass
	
	# Check if walls are Exterior
	count = 0
	for i in walls:
		f = int(i.WallType.Function)
		if f == 0:
			count += 1
	if w[0].WallType.Function == 0:
		count = count - 4
	
	TransactionManager.Instance.EnsureInTransaction(doc)
	
	doc.Delete(room.Id)
	for i in w:
		doc.Delete(i.Id)
	
	TransactionManager.Instance.TransactionTaskDone()
	
	# Out
	if count:
		OUT = str(count) + " of " + str(len(walls)) + " exterior walls have interior type."
	else:
		OUT = "Exterior walls types are OK."
else:
	OUT = "Exterior walls check is off."
# ----------------------------------------
stairs_formula_2 = Python(IN[0]=stairs_formula)
# ---------- stairs_formula_2.python (37 lines) ----------
import clr

clr.AddReference("RevitServices")
import RevitServices
from RevitServices.Persistence import DocumentManager

clr.AddReference("RevitAPI")
import Autodesk
from Autodesk.Revit.DB import *

doc = DocumentManager.Instance.CurrentDBDocument

condition = IN[0]

if condition:
	stairs = FilteredElementCollector(doc).WhereElementIsNotElementType().OfCategory(BuiltInCategory.OST_Stairs).ToElements()
	
	# Check if stairs steps are right height and depth
	count = 0
	for i in stairs:
		h = i.ActualRiserHeight * 30.48
		d = i.ActualTreadDepth * 30.48
		r = 2 * h + d
		if r < 61 or r > 63:
			count += 1
		elif h < 10 or h > 17.5:
			count += 1
		elif d < 26:
			count += 1
	
	# Out
	if count:
		OUT = str(count) + " of " + str(len(stairs)) + " stairs have bad formula."
	else:
		OUT = "Stairs formula are OK."
else:
	OUT = "Stairs formula check is off."
# ----------------------------------------
desired_head_height = DoubleInput(210)
stairs_head_height_2 = Python(IN[0]=stairs_head_height, IN[1]=desired_head_height)
# ---------- stairs_head_height_2.python (99 lines) ----------
import clr

clr.AddReference("RevitServices")
import RevitServices
from RevitServices.Persistence import DocumentManager
from RevitServices.Transactions import TransactionManager

clr.AddReference("RevitAPI")
import Autodesk
from Autodesk.Revit.DB import *

doc = DocumentManager.Instance.CurrentDBDocument

condition = IN[0]
height_offset = 10 / 30.48 # Thickness of checking solids
height = IN[1] / 30.48 - height_offset

opt = Options()
opt.ComputeReferences = False
opt.View = doc.ActiveView
opt.IncludeNonVisibleObjects = True

test = []

if condition:
	stairs = FilteredElementCollector(doc).WhereElementIsNotElementType().OfCategory(BuiltInCategory.OST_Stairs).ToElements()
	
	count_landings = 0
	count_runs = 0
	for i in stairs:
		landings = i.GetStairsLandings()
		for l in landings:
			landing = doc.GetElement(l)
			landing_z = landing.get_BoundingBox(doc.ActiveView).Max.Z
			landing_elev = landing.BaseElevation
			landing_p = landing.GetFootprintBoundary()
			looplist = []
			looplist.Add(landing_p)
			# Get extrusion vector, only direction is needed but for sure the point is on 0 point of solid bottom but Z is on solid top
			#point = landing.get_BoundingBox(doc.ActiveView).Max
			#extrusion_dir = XYZ(point.X, point.Y, height_offset)
			extrusion_dir = XYZ(0, 0, 1)
			# Create solid on "height" height from landing, with solid height of "height_offset"
			solid_landing = GeometryCreationUtilities.CreateExtrusionGeometry(looplist, extrusion_dir, height_offset)
			# Transform solid to the needed height
			t = Transform.CreateTranslation(XYZ(0, 0, height + landing_elev))
			transformed = SolidUtils.CreateTransformed(solid_landing, t)
			# Create filter to get intersecting elements
			filter = ElementIntersectsSolidFilter(transformed)
			# !!!! filter = ElementIntersectsSolidFilter(transformed)
			el = FilteredElementCollector(doc).WherePasses(filter).ToElements()
			count_landings += len(el)
		runs = i.GetStairsRuns()
		for r in runs:
			run = doc.GetElement(r)
			run_geom = run.get_Geometry(opt)
			# Get run solid that on top (in run might be second solid for topping)
			face_arrays = []
			run_solid = []
			g_bb_prev = -10000
			for g in run_geom:
				if isinstance(g, Solid):
					if g.Volume > 0:
						g_bb = g.GetBoundingBox().Max.Z
						if g_bb > g_bb_prev:
							face_arrays.append(g.Faces)
							run_prev = g_bb
			# Filter faces by normal going up
			run_faces = []
			for f_a in face_arrays:
				for f in f_a: 
					f_n_x = f.FaceNormal.X
					f_n_y = f.FaceNormal.Y
					f_n_z = f.FaceNormal.Z
					if f_n_x == 0 and f_n_y == 0 and f_n_z == 1:
						run_faces.append(f)
			# Making solid and check
			for r_f in run_faces:
				run_p = r_f.GetEdgesAsCurveLoops()
				extrusion_dir = XYZ(0, 0, 1)
				# Create solid on "height" height from landing, with solid height of "height_offset"
				solid_run = GeometryCreationUtilities.CreateExtrusionGeometry(run_p, extrusion_dir, height_offset)
				#test.append(solid_run)
				# Transform solid to the needed height
				t_f = Transform.CreateTranslation(XYZ(0, 0, height))
				transformed = SolidUtils.CreateTransformed(solid_run, t_f)
				# Create filter to get intersecting elements
				face_filter = ElementIntersectsSolidFilter(transformed)
				# !!!! filter = ElementIntersectsSolidFilter(transformed)
				er = FilteredElementCollector(doc).WherePasses(face_filter).ToElements()
				count_runs += len(er)
	
	# Out
	if count_landings or count_runs:
		OUT = str(count_landings) + " of stairs landings and " + str(count_runs) + " of runs have too low head height."
	else:
		OUT = "Stairs head heights are OK."
else:
	OUT = "Stairs head height check is off."
# ----------------------------------------
join = String.Join(prefix, prefix_4, groups_2, unused_linestyles_2, rooms_2, warnings_2, exterior_walls_2, stairs_formula_2, stairs_head_height_2)
result = Watch(join)
