# Dynamo graph TG_DWG_Name_Delete.dyn (Dynamo 1.3.4.6666)

string = StringInput("test")
run = BoolSelector(true)
delete_imports_with_string_in = Python(IN[0]=string, IN[1]=run)  # "Delete Imports with String in Name"
# ---------- delete_imports_with_string_in.python (37 lines) ----------
import clr

clr.AddReference("RevitServices")
import RevitServices
from RevitServices.Persistence import DocumentManager
from RevitServices.Transactions import TransactionManager

clr.AddReference("RevitAPI")
import Autodesk
from Autodesk.Revit.DB import *

doc = DocumentManager.Instance.CurrentDBDocument

imports = FilteredElementCollector(doc).OfClass(ImportInstance).ToElements()

string = IN[0]

delete = []
for i in imports:
	#  Checking for 2D or 3D
	if i.ViewSpecific:
		cat = i.Category
		if cat:
			name = i.Category.Name
			if string in name:
				delete.append(i.Id)

TransactionManager.Instance.EnsureInTransaction(doc)
	
count = 0
for i in delete:
	doc.Delete(i)
	count += 1

TransactionManager.Instance.TransactionTaskDone()

OUT = str(count) + " imports deleted."
# ----------------------------------------
result = Watch(delete_imports_with_string_in)
