# Dynamo graph TG_DWG_View_Found.dyn (Dynamo 1.3.4.6666)

run = BoolSelector(true)
python_script = Python(IN[0]=run)
# ---------- python_script.python (41 lines) ----------
import clr

clr.AddReference("RevitServices")
import RevitServices
from RevitServices.Persistence import DocumentManager

clr.AddReference("RevitAPI")
import Autodesk
from Autodesk.Revit.DB import *

doc = DocumentManager.Instance.CurrentDBDocument

imports = FilteredElementCollector(doc).OfClass(ImportInstance).ToElements()

imports_names = ["File"]
for i in imports:
	try:
		imports_names.append(i.Category.Name)
	except:
		imports_names.append("")


views = ["View"]
ids = ["Id"]
islink = ["Import type"]
for i in imports:
	#  Checking for 2D or 3D
	if i.ViewSpecific:
		views.append(doc.GetElement(i.OwnerViewId).Name)
	else:
		views.append("Not a view specific import")
	#  Checking for link or import
	if i.IsLinked:
		islink.append("Link")
	else:
		islink.append("Import")
	ids.append(i.Id)

data = [imports_names, views, ids, islink]

OUT = data
# ----------------------------------------
python_script_2 = Python(IN[0]=python_script)
# ---------- python_script_2.python (14 lines) ----------
imports_names = IN[0][0]
views = IN[0][1]
islink = IN[0][2]

result = []
i = 1 #  Index 0 is with columns heads so start with 1
while i < len(imports_names) - 1:
	n = imports_names[i]
	v = views[i]
	l = islink[i]
	result.append("[" + str(n) + "]" + " on view [" + str(v) + "] as " + str(l))
	i += 1

OUT = result
# ----------------------------------------
result = Watch(python_script_2)
file_path = Filename("No file selected.")
string = StringInput("Imports")
number = DoubleInput(0)
number_2 = DoubleInput(0)
transpose = List.Transpose(python_script)
boolean = BoolSelector(true)
writeToFile = Excel.WriteToFile(filePath=file_path, sheetName=string, startRow=number, startCol=number_2, data=transpose, overWrite=boolean)
