# Dynamo graph TG_Element_Paint_Remove.dyn (Dynamo 1.3.3.4111)

select_model_element = DSModelElementSelection()  # 1 picked in the model
python_script = Python(IN[0]=select_model_element)
# ---------- python_script.python (38 lines) ----------
import clr
clr.AddReference('ProtoGeometry')
from Autodesk.DesignScript.Geometry import *
clr.AddReference("RevitAPI")
from Autodesk.Revit.DB import *
clr.AddReference("RevitServices")
import RevitServices
from RevitServices.Persistence import DocumentManager
from RevitServices.Transactions import TransactionManager
doc = DocumentManager.Instance.CurrentDBDocument


element = UnwrapElement(IN[0])


Options().ComputeReferences = True


#  Get faces from geometry
faces = []
for geometry_instance in element.get_Geometry(Options()):
	if "Autodesk.Revit.DB.Solid" in str(geometry_instance):
		faces = geometry_instance.Faces
	

#  Transaction
TransactionManager.Instance.EnsureInTransaction(doc)

faces_cleared = 0
for i in faces:
	if Document.IsPainted(doc, element.Id, i) == True:
		Document.RemovePaint(doc, element.Id, i)
		faces_cleared += 1
		
TransactionManager.Instance.TransactionTaskDone()
	

OUT = str(faces_cleared) + " of " + str(len(list(faces))) + " faces have been cleared"
# ----------------------------------------
result = Watch(python_script)
