# Dynamo graph TG_Families_Replace.dyn (Dynamo 1.3.3.4111)

document_with_correct_families = Filename("Q:\00_General\01_BIM Standards\01_Standards\Revit Template\GSA_Catalog_2019_190502.rte")
python_script = Python(IN[0]=document_with_correct_families)
# ---------- python_script.python (84 lines) ----------
import clr
clr.AddReference("RevitNodes")
import Revit
clr.ImportExtensions(Revit.Elements)
clr.AddReference("RevitServices")
import System
import RevitServices
from RevitServices.Persistence import DocumentManager
from RevitServices.Transactions import TransactionManager
doc = DocumentManager.Instance.CurrentDBDocument
uiapp = DocumentManager.Instance.CurrentUIApplication
app = uiapp.Application
clr.AddReference("RevitAPI")
import Autodesk
from Autodesk.Revit.DB import *

import sys
pyt_path = r'C:\Program Files (x86)\IronPython 2.7\Lib'
sys.path.append(pyt_path)

#Source document with correct families
doc_source = app.OpenDocumentFile(IN[0])

#Families
elements_source = []
elements_target = []

#Names of families
elements_source_name = []
elements_target_name = []
elements_source_name_filtered = []

result = []

#Ensure loaded families can overwrite existing families
class FamilyOption(IFamilyLoadOptions):
    def OnFamilyFound(self, familyInUse, overwriteParameterValues):
        overwriteParameterValues = True
        return True

    def OnSharedFamilyFound(self, sharedFamily, familyInUse, source, overwriteParameterValues):
        source = FamilySource.Family
        overwriteParameterValues = True
        return True

try:
	errorReport = None
	
	#Collecting families from both files
	elements_source = FilteredElementCollector(doc_source).OfClass(Family).ToElements()
	elements_target = FilteredElementCollector(doc).OfClass(Family).ToElements()
		
	#Adding families to filtered list if families have same names
	for i in elements_source:
		elements_source_name.append(Element.Name.GetValue(i).ToString())
	for i in elements_target:
		elements_target_name.append(Element.Name.GetValue(i).ToString())
	for i in elements_source_name:
		for j in elements_target_name:
			if i == j:
				elements_source_name_filtered.append(i)
	
	#Closing all transactions
	TransactionManager.Instance.ForceCloseTransaction()
	
	#Replacing families by opening and loading them
	for i in elements_source:
		if Element.Name.GetValue(i).ToString() in elements_source_name_filtered:
			if i.IsEditable:
				editing = doc_source.EditFamily(i)
				editing.LoadFamily(doc, FamilyOption())
				editing.Close(False)
				result.append("Family " + Element.Name.GetValue(i).ToString() + " was replaced")
	
except:
	#If error accurs anywhere in the process catch it
	import traceback
	errorReport = traceback.format_exc()
	
#Assign your output to the OUT variable
if errorReport == None:
	OUT = result
else:
	OUT = errorReport
# ----------------------------------------
result = Watch(python_script)
