# Dynamo graph TG_Family_View_Found.dyn (Dynamo 2.6.1.8786)

run = BoolSelector(true)
python_script = Python(IN[0]=run)
# ---------- python_script.python (43 lines) ----------
import clr

clr.AddReference("RevitServices")
import RevitServices
from RevitServices.Persistence import DocumentManager

clr.AddReference("RevitAPI")
import Autodesk
from Autodesk.Revit.DB import *

clr.AddReference("RevitAPIUI")
from Autodesk.Revit.UI.Selection import Selection

doc = DocumentManager.Instance.CurrentDBDocument
uidoc = DocumentManager.Instance.CurrentUIApplication.ActiveUIDocument


elements = uidoc.Selection.GetElementIds()
try:
	elements_list = [i for i in elements]
except:
	elements_list = [elements]

"""
element_symbol = FilteredElementCollector(doc).OfClass(typeof(FamilySymbol)).WhereElementIsElementType().ToElements().Where(element.Name == elementName)
element_symbol_id = element.GetTypeId()
fif = FamilyInstanceFilter(doc, element_symbol_id)
imports = FilteredElementCollector(doc).WherePasses(fif).ToElements()
"""

views = ["View"]
ids = ["Id"]
for i in elements_list:
	#  Checking for 2D or 3D
	try:
		views.append(doc.GetElement(i).View.Name)
	except:
		views.append("Not a 2D element")
	ids.append(i)

data = [views, ids]

OUT = data
# ----------------------------------------
python_script_2 = Python(IN[0]=python_script)
# ---------- python_script_2.python (18 lines) ----------
views = IN[0][0]
views_set = list(set(views))

result = []
i = 1 #  Index 0 is with columns heads so start with 1


for i in views_set:
	count = 0
	if not i == "View":
		for j in views:
			if i == j:
				count += 1
		result.append("[ " + str(i) + " ] - " + str(count) + " instances.")
	else:
		pass

OUT = result
# ----------------------------------------
result = Watch(python_script_2)
file_path = Filename("No file selected.")  # graph input
string = StringInput("Views")
number = DoubleInput(0)
number_2 = DoubleInput(0)
transpose = List.Transpose(lists=python_script)
boolean = BoolSelector(true)
exportExcel = Data.ExportExcel(filePath=file_path, sheetName=string, startRow=number, startCol=number_2, data=transpose, overWrite=boolean)
