# Dynamo graph TG_Family_Voids_Select.dyn (Dynamo 1.3.4.6666)

restart = BoolSelector(false)
python_script = Python(IN[0]=restart)
# ---------- python_script.python (52 lines) ----------
import clr
clr.AddReference("RevitAPI")
from Autodesk.Revit.DB import *
clr.AddReference("RevitAPIUI")
from Autodesk.Revit.UI.Selection import Selection
clr.AddReference("RevitServices")
import RevitServices
from RevitServices.Persistence import DocumentManager
from RevitServices.Transactions import TransactionManager
from System.Collections.Generic import List
doc = DocumentManager.Instance.CurrentDBDocument
uidoc = DocumentManager.Instance.CurrentUIApplication.ActiveUIDocument


family = doc.OwnerFamily


def FindVoids(elements):
	voids = [i for i in elements if not i.IsSolid]
	return voids


Options().ComputeReferences = True
Options().IncludeNonVisibleObjects = True


#  Get geometry primitives
prim_ext = FilteredElementCollector(doc).OfClass(Extrusion).ToElements()
prim_bln = FilteredElementCollector(doc).OfClass(Blend).ToElements()
prim_rev = FilteredElementCollector(doc).OfClass(Revolution).ToElements()
prim_swe = FilteredElementCollector(doc).OfClass(Sweep).ToElements()
prim_swb = FilteredElementCollector(doc).OfClass(SweptBlend).ToElements()

#  Find voids
voids = []
voids.extend(FindVoids(prim_ext))
voids.extend(FindVoids(prim_bln))
voids.extend(FindVoids(prim_rev))
voids.extend(FindVoids(prim_swe))
voids.extend(FindVoids(prim_swb))

#  Selection
ids = List[ElementId]()
for i in voids:
	ids.Add(i.Id)
sel = uidoc.Selection.SetElementIds(ids)

#  Output
if ids:
	OUT = str(len(ids)) + " voids selected."
else:
	OUT = "No voids are in the family."
# ----------------------------------------
result = Watch(python_script)
