# Dynamo graph TG_Family_Zero_Lines.dyn (Dynamo 2.6.1.8786)

boolean = BoolSelector(true)
python_script = Python(IN[0]=boolean)
# ---------- python_script.python (55 lines) ----------
import clr
clr.AddReference("RevitAPI")
from Autodesk.Revit.DB import *
clr.AddReference("RevitServices")
import RevitServices
from RevitServices.Persistence import DocumentManager
from RevitServices.Transactions import TransactionManager

clr.AddReference("RevitAPIUI")
import Autodesk.Revit.UI
import Autodesk.Revit.UI.Selection

clr.AddReference("System.Collections")
from System.Collections.Generic import List

doc = DocumentManager.Instance.CurrentDBDocument
uidoc = DocumentManager.Instance.CurrentUIApplication.ActiveUIDocument
view = doc.ActiveView



length = 1

o = XYZ(0, 0, 0)
a = XYZ(length, 0, 0)
b = XYZ(0, length, 0)
c = XYZ(0-length, 0, 0)
d = XYZ(0, 0-length, 0)
 
 
TransactionManager.Instance.EnsureInTransaction(doc)
	

l_0 = Line.CreateBound(o, a)
d_0 = doc.FamilyCreate.NewDetailCurve(view, l_0)
l_1 = Line.CreateBound(o, b)
d_1 = doc.FamilyCreate.NewDetailCurve(view, l_1)
l_2 = Line.CreateBound(o, c)
d_2 = doc.FamilyCreate.NewDetailCurve(view, l_2)
l_3 = Line.CreateBound(o, d)
d_3 = doc.FamilyCreate.NewDetailCurve(view, l_3)


TransactionManager.Instance.TransactionTaskDone()

	
sel_list = List[ElementId]()
sel_list.Add(d_0.Id)
sel_list.Add(d_1.Id)
sel_list.Add(d_2.Id)
sel_list.Add(d_3.Id)
	
uidoc.Selection.SetElementIds(sel_list)
	
OUT = "Center marked with lines."
# ----------------------------------------
result = Watch(python_script)
