# Dynamo graph TG_Floors_Section_Dimension.dyn (Dynamo 2.3.0.5885)

spot_elevations = BoolSelector(true)  # graph input
topping_thickness = DoubleInput(0)  # graph input
spot_offset = DoubleSlider(1, range=-10..10 step 0.1)  # graph input
python_script = Python(IN[0]=spot_elevations, IN[1]=topping_thickness, IN[2]=spot_offset)
# ---------- python_script.python (223 lines) ----------
import clr

# Import RevitAPI
clr.AddReference("RevitAPI")
from Autodesk.Revit.DB import *

clr.AddReference("RevitAPIUI")
from Autodesk.Revit.UI.Selection import ISelectionFilter
from Autodesk.Revit.UI.Selection import ObjectType

clr.AddReference("ProtoGeometry")
from Autodesk.DesignScript import Geometry as geom

# Import DocumentManager and TransactionManager
clr.AddReference("RevitServices")
import RevitServices
from RevitServices.Persistence import DocumentManager
from RevitServices.Transactions import TransactionManager

doc = DocumentManager.Instance.CurrentDBDocument
uidoc = DocumentManager.Instance.CurrentUIApplication.ActiveUIDocument
view = doc.ActiveView

condition = IN[0]
thickness = IN[1] / 30.48  #  Thickness of floor that recognize as concrete
offset = IN[2] / 30.48  #  Offset for spot elevations on thin floors

#  Selection filter for category
class SelectionFilter(ISelectionFilter):
    def __init__(self, category_name):
        self.category_name = category_name
    def AllowElement(self, e):
        if e.Category.Name == self.category_name:
            return True
        else:
            return False

opts = Options()
opts.ComputeReferences = True
opts.IncludeNonVisibleObjects = False
opts.View = view

#  Transforming offset to world coordinates
view_dir_x = view.ViewDirection.X
view_dir_y = view.ViewDirection.Y
offset_scaled_x = offset * view.Scale * view_dir_x
offset_scaled_y = offset * view.Scale * view_dir_y
off = XYZ(0 - offset_scaled_y, offset_scaled_x, 0)

#  Select line by user
line_ref = uidoc.Selection.PickObject(ObjectType.Element, SelectionFilter("Lines"), "Select Line")
line = doc.GetElement(line_ref)
curve = line.GeometryCurve

#  Select all floors in the view
floors = FilteredElementCollector(doc, doc.ActiveView.Id).OfClass(Floor).ToElements()

#  Divide floors to thick and thin for spot elevations arrangement
floors_thin = []
floors_thick = []
for f in floors:
	f_type = f.FloorType
	f_thick = f_type.get_Parameter(BuiltInParameter.FLOOR_ATTR_DEFAULT_THICKNESS_PARAM).AsDouble()
	if f_thick > thickness:
		floors_thick.append(f)
	else:
		floors_thin.append(f)

#  List for intersection points
intersections_thick_top = []
intersections_thick_bot = []
#  Some conversion
ira = clr.StrongBox[IntersectionResultArray](IntersectionResultArray())
point = XYZ(0,0,0)
#  Iterate through floors solids and get faces
intersection_faces_thick_top = []
intersection_faces_thick_bot = []
for f in floors_thick:
    for obj in f.get_Geometry(opts):
        if isinstance(obj, Solid):
        	faces = obj.Faces
        	for face in faces:
        		#  Some faces are cylidrical so catch exception on FaceNormal
        		try:
        			#  Check if faces are horisontal
        			if round(face.FaceNormal.X) == 0 and round(face.FaceNormal.Y) == 0 and round(face.FaceNormal.Z) == 1:
        				intersection = face.Intersect(curve, ira)
        				if intersection == SetComparisonResult.Overlap:
    						point = ira.get_Item(0).XYZPoint
    						#  Collecting unique intersection points
        					intersections_thick_top.append(face.Reference)
        					#  Collecting faces for spot elevations
        					intersection_faces_thick_top.append(face)
        			if round(face.FaceNormal.X) == 0 and round(face.FaceNormal.Y) == 0 and round(face.FaceNormal.Z) == -1:
        				intersection = face.Intersect(curve, ira)
        				if intersection == SetComparisonResult.Overlap:
    						point = ira.get_Item(0).XYZPoint
    						#  Collecting unique intersection points
        					intersections_thick_bot.append(face.Reference)
        					#  Collecting faces for spot elevations
        					intersection_faces_thick_bot.append(face)
        		except:
        			pass


#  List for intersection points
intersections_thin = []
#  Some conversion
ira = clr.StrongBox[IntersectionResultArray](IntersectionResultArray())
#  Iterate through floors solids and get faces
intersection_faces_thin = []
for f in floors_thin:
    for obj in f.get_Geometry(opts):
        if isinstance(obj, Solid):
        	faces = obj.Faces
        	for face in faces:
        		#  Some faces are cylidrical so catch exception on FaceNormal
        		try:
        			#  Check if faces are horisontal AND looking up
        			if round(face.FaceNormal.X) == 0 and round(face.FaceNormal.Y) == 0 and round(face.FaceNormal.Z) == 1:
        				intersection = face.Intersect(curve, ira)
        				if intersection == SetComparisonResult.Overlap:
    						point = ira.get_Item(0).XYZPoint
    						#  Collecting unique intersection points
        					intersections_thin.append(face.Reference)
        					#  Collecting faces for spot elevations
        					intersection_faces_thin.append(face)
        		except:
        			pass



#  Convert lists to ReferenceArray
count = 0
references = ReferenceArray()
try:
	references.Append(intersections_thick_top[0])
	count += 1
except:
	pass
for i in intersections_thick_top:
	if i not in references:
		references.Append(i)
		count += 1

try:
	references.Append(intersections_thick_bot[0])
	count += 1
except:
	pass
for i in intersections_thick_bot:
	if i not in references:
		references.Append(i)
		count += 1
try:
	references.Append(intersections_thin[0])
	count += 1
except:
	pass
for i in intersections_thin:
	if i not in references:
		references.Append(i)
		count += 1
if count:
	count -= 1

count_spots = 0
spots_move = []
#  Start transaction
TransactionManager.Instance.EnsureInTransaction(doc)
#  Create dimensions
if condition:
	origin_x = point.X
	origin_y = point.Y
	bend = XYZ(0, 0, 0)
	end = XYZ(0, 0, 0)
	#  Spots for thick floors
	for i, j in zip(intersections_thick_top, intersection_faces_thick_top):
		origin_z = j.Origin.Z
		origin = XYZ(origin_x, origin_y, origin_z)
		try:
			spot = doc.Create.NewSpotElevation(view, i, origin, bend, end, origin, False)
			count_spots += 1
		except:
			pass
	for i, j in zip(intersections_thick_bot, intersection_faces_thick_bot):
		origin_z = j.Origin.Z
		origin = XYZ(origin_x, origin_y, origin_z)
		try:
			spot = doc.Create.NewSpotElevation(view, i, origin, bend, end, origin, False)
			count_spots += 1
		except:
			pass
		#  Flipping tag
		id = spot.Id
		plane = j.GetSurface()
		ElementTransformUtils.MirrorElement(doc, id, plane)
	#  Spots for thin floors
	for i, j in zip(intersections_thin, intersection_faces_thin):
		origin_z = j.Origin.Z
		origin = XYZ(origin_x, origin_y, origin_z)
		try:
			spot = doc.Create.NewSpotElevation(view, i, origin, bend, end, origin, False)
			count_spots += 1
		except:
			pass
		spots_move.append(spot)
	#  Moving tags
	for m in spots_move:
		m.Location.Move(off)
else:
	try:
		dim = doc.Create.NewDimension(view, curve, references)
	except:
		pass
#  Finish transaction    
TransactionManager.Instance.TransactionTaskDone()

#  Output
if condition:
	OUT = str(count_spots) + " spot elevations were created."
else:
	OUT = "Dimension with " + str(count) + " segments was created."
# ----------------------------------------
result = Watch(python_script)
