# Dynamo graph TG_Grids_Switch2D.dyn (Dynamo 1.3.4.6666)

switch_to_2d = BoolSelector(true)
tags_on_side_1 = BoolSelector(true)
tags_on_side_2 = BoolSelector(false)
python_script = Python(IN[0]=switch_to_2d, IN[1]=tags_on_side_1, IN[2]=tags_on_side_2)
# ---------- python_script.python (53 lines) ----------
import clr

clr.AddReference("RevitServices")
import RevitServices
from RevitServices.Persistence import DocumentManager
from RevitServices.Transactions import TransactionManager

clr.AddReference("RevitAPI")
import Autodesk
from Autodesk.Revit.DB import *

doc = DocumentManager.Instance.CurrentDBDocument
view = doc.ActiveView
view_id = doc.ActiveView.Id

condition_switch = IN[0]
condition_side = IN[1]
condition_side_2 = IN[2]

grids = FilteredElementCollector(doc, view_id).OfCategory(BuiltInCategory.OST_Grids).ToElements()

extent_mode = DatumExtentType.ViewSpecific

TransactionManager.Instance.EnsureInTransaction(doc)

if grids:
	curve = grids[0].GetCurvesInView(extent_mode, view)[0]
	curve_1_x = curve.GetEndPoint(0).X
	curve_1_y = curve.GetEndPoint(0).Y
	curve_2_x = curve.GetEndPoint(1).X
	curve_2_y = curve.GetEndPoint(1).Y

count = 0
for i in grids:
	if condition_switch:
		i.SetDatumExtentType(DatumEnds.End0, view, extent_mode)
		i.SetDatumExtentType(DatumEnds.End1, view, extent_mode)
		count += 1
	else:
		pass
		
	if not condition_side:
		i.HideBubbleInView(DatumEnds.End0, view)
	else:
		i.ShowBubbleInView(DatumEnds.End0, view)
	if not condition_side_2:
		i.HideBubbleInView(DatumEnds.End1, view)
	else:
		i.ShowBubbleInView(DatumEnds.End1, view)

TransactionManager.Instance.TransactionTaskDone()

OUT = str(count) + " of grids extents were switched to 2D"
# ----------------------------------------
result = Watch(python_script)
