# Dynamo graph TG_Group_Find.dyn (Dynamo 2.6.1.8786)

select_model_element = DSModelElementSelection()  # 1 picked in the model
boolean = BoolSelector(true)
python_script = Python(IN[0]=select_model_element, IN[1]=boolean)
# ---------- python_script.python (36 lines) ----------
import clr
clr.AddReference("RevitAPI")
from Autodesk.Revit.DB import *
clr.AddReference("RevitServices")
import RevitServices
from RevitServices.Persistence import DocumentManager
from RevitServices.Transactions import TransactionManager

clr.AddReference("RevitAPIUI")
import Autodesk.Revit.UI
import Autodesk.Revit.UI.Selection

clr.AddReference("System.Collections")
from System.Collections.Generic import List

doc = DocumentManager.Instance.CurrentDBDocument
uidoc = DocumentManager.Instance.CurrentUIApplication.ActiveUIDocument



element = UnwrapElement(IN[0])

group_id = element.GroupId

try:
	group = doc.GetElement(group_id)
	group_name = group.Name
	
	sel_list = List[ElementId]()
	sel_list.Add(group_id)
	
	uidoc.Selection.SetElementIds(sel_list)
	
	OUT = "Name of the group: " + group_name
except AttributeError:
	OUT = "Element not in a group."
# ----------------------------------------
result = Watch(python_script)
