# Dynamo graph TG_Levels_Switch2D.dyn (Dynamo 1.3.4.6666)

switch_to_2d = BoolSelector(true)
align_ends = BoolSelector(true)
tags_on_side_1 = BoolSelector(false)
tags_on_side_2 = BoolSelector(false)
python_script = Python(IN[0]=switch_to_2d, IN[1]=align_ends, IN[2]=tags_on_side_1, IN[3]=tags_on_side_2)
# ---------- python_script.python (80 lines) ----------
import clr

clr.AddReference("RevitServices")
import RevitServices
from RevitServices.Persistence import DocumentManager
from RevitServices.Transactions import TransactionManager

clr.AddReference("RevitAPI")
import Autodesk
from Autodesk.Revit.DB import *

doc = DocumentManager.Instance.CurrentDBDocument
view = doc.ActiveView
view_id = doc.ActiveView.Id

condition_switch = IN[0]
condition_align = IN[1]
condition_side = IN[2]
condition_side_2 = IN[3]

levels = FilteredElementCollector(doc, view_id).OfCategory(BuiltInCategory.OST_Levels).ToElements()

extent_mode = DatumExtentType.ViewSpecific

TransactionManager.Instance.EnsureInTransaction(doc)

if levels:
	curve = levels[0].GetCurvesInView(extent_mode, view)[0]
	curve_1_x = curve.GetEndPoint(0).X
	curve_1_y = curve.GetEndPoint(0).Y
	curve_2_x = curve.GetEndPoint(1).X
	curve_2_y = curve.GetEndPoint(1).Y

count = 0
for i in levels:
	if condition_switch:
		i.SetDatumExtentType(DatumEnds.End0, view, extent_mode)
		i.SetDatumExtentType(DatumEnds.End1, view, extent_mode)
		count += 1
	else:
		pass
		
	if condition_align:
		#  Get a line of the current level
		curve_current = i.GetCurvesInView(extent_mode, view)[0]
		#  Get two points of the line
		curve_current_z_1 = curve_current.GetEndPoint(0).Z
		curve_current_z_2 = curve_current.GetEndPoint(1).Z
		#  New coordinates with X changed
		coo_new_1 = XYZ(curve_1_x, curve_1_y, curve_current_z_1)
		coo_new_2 = XYZ(curve_2_x, curve_2_y, curve_current_z_2)
		curve_new = Line.CreateBound(coo_new_1, coo_new_2)
		
		i.SetCurveInView(extent_mode, view, curve_new)
	else:
		pass
		
	if not condition_side:
		i.HideBubbleInView(DatumEnds.End0, view)
	else:
		i.ShowBubbleInView(DatumEnds.End0, view)
	if not condition_side_2:
		i.HideBubbleInView(DatumEnds.End1, view)
	else:
		i.ShowBubbleInView(DatumEnds.End1, view)

TransactionManager.Instance.TransactionTaskDone()

#  Output
text = str(count)
if condition_switch:
	text += " of levels extents were switched to 2D."
if condition_align:
	text += " Levels ends aligned."
if condition_side or condition_side_2:
	pass
else:
	text += " levels found."

OUT = text
# ----------------------------------------
result = Watch(python_script)
