# Dynamo graph TG_Linestyles_Unused_Delete.dyn (Dynamo 1.3.4.6666)

delete = BoolSelector(false)
python_script = Python(IN[0]=delete)
# ---------- python_script.python (57 lines) ----------
import clr
clr.AddReference("RevitNodes")
import Revit
clr.ImportExtensions(Revit.Elements)
clr.ImportExtensions(Revit.GeometryConversion)
clr.AddReference("RevitServices")
import RevitServices
from RevitServices.Persistence import DocumentManager
from RevitServices.Transactions import TransactionManager
from System.Collections.Generic import *

clr.AddReference("RevitAPI")
import Autodesk
from Autodesk.Revit.DB import *
doc = DocumentManager.Instance.CurrentDBDocument
uiapp = DocumentManager.Instance.CurrentUIApplication
app = uiapp.Application
uidoc=DocumentManager.Instance.CurrentUIApplication.ActiveUIDocument


delete = IN[0]


#  Selecting used line styles in a project
lines_used = FilteredElementCollector(doc).OfCategory(BuiltInCategory.OST_Lines).WhereElementIsNotElementType().ToElements()
line_styles_used = []
for i in lines_used:
	line_style = i.LineStyle.Id
	if not line_style in line_styles_used:
		line_styles_used.append(line_style)

#  Selecting all line styles in the project
line_styles_all = doc.Settings.Categories.get_Item(BuiltInCategory.OST_Lines).SubCategories
line_styles = [i.Id for i in line_styles_all]

TransactionManager.Instance.EnsureInTransaction(doc)

#  Deleting unused line styles
count = 0
for i in line_styles:
	if not i in line_styles_used:
		if delete:
			try:
				doc.Delete(i)
				count += 1
			except:
				pass
		else:
			count += 1

TransactionManager.Instance.TransactionTaskDone()

#  Output
if delete:
	OUT = str(count) + " line styles were unused and deleted."
else:
	OUT = str(count) + " line styles are unused."
# ----------------------------------------
result = Watch(python_script)
