# Dynamo graph TG_Linetypes_IMPORT_Delete.dyn (Dynamo 1.3.4.6666)

string = StringInput("IMPORT")
delete = BoolSelector(false)
python_script = Python(IN[0]=string, IN[1]=delete)
# ---------- python_script.python (35 lines) ----------
import clr
clr.AddReference("RevitAPI")
from Autodesk.Revit.DB import *
clr.AddReference("RevitServices")
import RevitServices
from RevitServices.Persistence import DocumentManager
from RevitServices.Transactions import TransactionManager

doc = DocumentManager.Instance.CurrentDBDocument


string = IN[0]
delete = IN[1]


line_patterns = FilteredElementCollector(doc).OfClass(LinePatternElement).ToElements()

TransactionManager.Instance.EnsureInTransaction(doc)

count = 0
for line_pattern in line_patterns:
	name = line_pattern.Name
	if string in name:
		id = line_pattern.Id
		if delete:
			doc.Delete(id)
		count += 1

TransactionManager.Instance.TransactionTaskDone()

#  Output
if delete:
	OUT = str(count) + " line patterns deleted."
else:
	OUT = str(count) + " line patterns found."
# ----------------------------------------
result = Watch(python_script)
