# Dynamo graph TG_Names_Prefix_Change.dyn (Dynamo 1.3.4.6666)

# group: Prefixes
input = StringInput("GSA")
output = StringInput("XXX")

# group: Check
families = BoolSelector(true)
area_schemes = BoolSelector(true)
manage = BoolSelector(true)
massing_site = BoolSelector(true)
architecture = BoolSelector(true)
annotate = BoolSelector(true)
groups = BoolSelector(true)
view = BoolSelector(true)
materials = BoolSelector(true)

python_script = Python(IN[0]=input, IN[1]=output, IN[2]=families)
# ---------- python_script.python (38 lines) ----------
import clr
clr.AddReference('RevitServices')
import RevitServices
from RevitServices.Persistence import DocumentManager
from RevitServices.Transactions import TransactionManager

clr.AddReference('RevitAPI')

import Autodesk
from Autodesk.Revit.DB import *
from Autodesk.Revit.DB import FilteredElementCollector

doc = DocumentManager.Instance.CurrentDBDocument

prefix_old = IN[0]
prefix_new = IN[1]
conditions = IN[2]

# Collecting all elements of classes to a lists
Family_types_all = FilteredElementCollector(doc).OfClass(FamilySymbol).ToElements()

# Creating empty lists for cycles (names, filtered elements)
Family_types_name = []
Family_types_filtered = []

if conditions:
	for i in Family_types_all:
		# Name of the current element in the list of elements
		i_name = Element.Name.GetValue(i).ToString()
		# Comparing prefix and name strings
		if prefix_old in i_name:
			# Adding element name to names list
			Family_types_name.append(Element.Name.GetValue(i).ToString())
			# Adding element to filtered elenemts list
			Family_types_filtered.append(i)
		
# Joining lists
OUT = Family_types_filtered
# ----------------------------------------

# group: Families
python_script_2 = Python(IN[0]=input, IN[1]=output, IN[2]=families)
# ---------- python_script_2.python (38 lines) ----------
import clr
clr.AddReference('RevitServices')
import RevitServices
from RevitServices.Persistence import DocumentManager
from RevitServices.Transactions import TransactionManager

clr.AddReference('RevitAPI')

import Autodesk
from Autodesk.Revit.DB import *
from Autodesk.Revit.DB import FilteredElementCollector

doc = DocumentManager.Instance.CurrentDBDocument

prefix_old = IN[0]
prefix_new = IN[1]
conditions = IN[2]

# Collecting all elements of classes to a lists
Family_all = FilteredElementCollector(doc).OfClass(Family).ToElements()

# Creating empty lists for cycles (names, filtered elements)
Family_name = []
Family_filtered = []

if conditions:
	for i in Family_all:
		# Name of the current element in the list of elements
		i_name = Element.Name.GetValue(i).ToString()
		# Comparing prefix and name strings
		if prefix_old in i_name:
			# Adding element name to names list
			Family_name.append(Element.Name.GetValue(i).ToString())
			# Adding element to filtered elenemts list
			Family_filtered.append(i)
		
# Joining lists
OUT = Family_filtered
# ----------------------------------------
name = Element.Name(python_script_2)
replace = String.Replace(str=name, searchFor=input, replaceWith=output)

# group: Area Schemes
python_script_3 = Python(IN[0]=input, IN[1]=output, IN[2]=area_schemes)
# ---------- python_script_3.python (38 lines) ----------
import clr
clr.AddReference('RevitServices')
import RevitServices
from RevitServices.Persistence import DocumentManager
from RevitServices.Transactions import TransactionManager

clr.AddReference('RevitAPI')

import Autodesk
from Autodesk.Revit.DB import *
from Autodesk.Revit.DB import FilteredElementCollector

doc = DocumentManager.Instance.CurrentDBDocument

prefix_old = IN[0]
prefix_new = IN[1]
conditions = IN[2]

# Collecting all elements of classes to a lists
AreaScheme_all = FilteredElementCollector(doc).OfClass(AreaScheme).ToElements()

# Creating empty lists for cycles (names, filtered elements)
AreaScheme_name = []
AreaScheme_filtered = []

if conditions:
	for i in AreaScheme_all:
		# Name of the current element in the list of elements
		i_name = Element.Name.GetValue(i).ToString()
		# Comparing prefix and name strings
		if prefix_old in i_name:
			# Adding element name to names list
			AreaScheme_name.append(Element.Name.GetValue(i).ToString())
			# Adding element to filtered elenemts list
			AreaScheme_filtered.append(i)
		
# Joining lists
OUT = AreaScheme_filtered
# ----------------------------------------
name_2 = Element.Name(python_script_3)
replace_2 = String.Replace(str=name_2, searchFor=input, replaceWith=output)

# group: Manage
python_script_4 = Python(IN[0]=input, IN[1]=output, IN[2]=manage)
# ---------- python_script_4.python (47 lines) ----------
import clr
clr.AddReference('RevitServices')
import RevitServices
from RevitServices.Persistence import DocumentManager
from RevitServices.Transactions import TransactionManager

clr.AddReference('RevitAPI')

import Autodesk
from Autodesk.Revit.DB import *
from Autodesk.Revit.DB import FilteredElementCollector

doc = DocumentManager.Instance.CurrentDBDocument

prefix_old = IN[0]
prefix_new = IN[1]
conditions = IN[2]

# Collecting all elements of classes to a lists
BrowserOrganization_all = FilteredElementCollector(doc).OfClass(BrowserOrganization).ToElements()
LinePatternElement_all = FilteredElementCollector(doc).OfClass(LinePatternElement).ToElements()

# Creating empty lists for cycles (names, filtered elements)
BrowserOrganization_name = []
BrowserOrganization_filtered = []
LinePatternElement_name = []
LinePatternElement_filtered = []

if conditions:
	for i in BrowserOrganization_all:
		# Name of the current element in the list of elements
		i_name = Element.Name.GetValue(i).ToString()
		# Comparing prefix and name strings
		if prefix_old in i_name:
			# Adding element name to names list
			BrowserOrganization_name.append(Element.Name.GetValue(i).ToString())
			# Adding element to filtered elenemts list
			BrowserOrganization_filtered.append(i)
			
	for i in LinePatternElement_all:
		i_name = Element.Name.GetValue(i).ToString()
		if prefix_old in i_name:
			LinePatternElement_name.append(Element.Name.GetValue(i).ToString())
			LinePatternElement_filtered.append(i)
		
# Joining lists
OUT = BrowserOrganization_filtered + LinePatternElement_filtered
# ----------------------------------------
name_3 = Element.Name(python_script_4)
replace_3 = String.Replace(str=name_3, searchFor=input, replaceWith=output)

# group: Massing & Site
python_script_5 = Python(IN[0]=input, IN[1]=output, IN[2]=massing_site)
# ---------- python_script_5.python (38 lines) ----------
import clr
clr.AddReference('RevitServices')
import RevitServices
from RevitServices.Persistence import DocumentManager
from RevitServices.Transactions import TransactionManager

clr.AddReference('RevitAPI')

import Autodesk
from Autodesk.Revit.DB import *
from Autodesk.Revit.DB import FilteredElementCollector

doc = DocumentManager.Instance.CurrentDBDocument

prefix_old = IN[0]
prefix_new = IN[1]
conditions = IN[2]

# Collecting all elements of classes to a lists
BuildingPadType_all = FilteredElementCollector(doc).OfClass(BuildingPadType).ToElements()

# Creating empty lists for cycles (names, filtered elements)
BuildingPadType_name = []
BuildingPadType_filtered = []

if conditions:
	for i in BuildingPadType_all:
		# Name of the current element in the list of elements
		i_name = Element.Name.GetValue(i).ToString()
		# Comparing prefix and name strings
		if prefix_old in i_name:
			# Adding element name to names list
			BuildingPadType_name.append(Element.Name.GetValue(i).ToString())
			# Adding element to filtered elenemts list
			BuildingPadType_filtered.append(i)
		
# Joining lists
OUT = BuildingPadType_filtered
# ----------------------------------------
name_4 = Element.Name(python_script_5)
replace_4 = String.Replace(str=name_4, searchFor=input, replaceWith=output)

# group: Architecture
python_script_6 = Python(IN[0]=input, IN[1]=output, IN[2]=architecture)
# ---------- python_script_6.python (165 lines) ----------
import clr
clr.AddReference('RevitServices')
import RevitServices
from RevitServices.Persistence import DocumentManager
from RevitServices.Transactions import TransactionManager

clr.AddReference('RevitAPI')

import Autodesk
from Autodesk.Revit.DB import *
from Autodesk.Revit.DB.Architecture import *
from Autodesk.Revit.DB import FilteredElementCollector

doc = DocumentManager.Instance.CurrentDBDocument

prefix_old = IN[0]
prefix_new = IN[1]
conditions = IN[2]

# Collecting all elements of classes to a lists
CeilingType_all = FilteredElementCollector(doc).OfClass(CeilingType).ToElements()
ContinuousRailType_all = FilteredElementCollector(doc).OfClass(ContinuousRailType).ToElements()
RailingType_all = FilteredElementCollector(doc).OfClass(RailingType).ToElements()
CurtainSystemType_all = FilteredElementCollector(doc).OfClass(CurtainSystemType).ToElements()
RoofType_all = FilteredElementCollector(doc).OfClass(RoofType).ToElements()
FasciaType_all = FilteredElementCollector(doc).OfClass(FasciaType).ToElements()
GutterType_all = FilteredElementCollector(doc).OfClass(GutterType).ToElements()
GridType_all = FilteredElementCollector(doc).OfClass(GridType).ToElements()
LevelType_all = FilteredElementCollector(doc).OfClass(LevelType).ToElements()
WallType_all = FilteredElementCollector(doc).OfClass(WallType).ToElements()
StairsType_all = FilteredElementCollector(doc).OfClass(StairsType).ToElements()
StairsRunType_all = FilteredElementCollector(doc).OfClass(StairsRunType).ToElements()
StairsLandingType_all = FilteredElementCollector(doc).OfClass(StairsLandingType).ToElements()
PanelType_all = FilteredElementCollector(doc).OfClass(PanelType).ToElements()
WallFoundationType_all = FilteredElementCollector(doc).OfClass(WallFoundationType).ToElements()

# Creating empty lists for cycles (names, filtered elements)
CeilingType_name = []
CeilingType_filtered = []
ContinuousRailType_name = []
ContinuousRailType_filtered = []
RailingType_name = []
RailingType_filtered = []
CurtainSystemType_name = []
CurtainSystemType_filtered = []
RoofType_name = []
RoofType_filtered = []
FasciaType_name = []
FasciaType_filtered = []
GutterType_name = []
GutterType_filtered = []
GridType_name = []
GridType_filtered = []
LevelType_name = []
LevelType_filtered = []
WallType_name = []
WallType_filtered = []
StairsType_name = []
StairsType_filtered = []
StairsRunType_name = []
StairsRunType_filtered = []
StairsLandingType_name = []
StairsLandingType_filtered = []
PanelType_name = []
PanelType_filtered = []
WallFoundationType_name = []
WallFoundationType_filtered = []

if conditions:
	for i in CeilingType_all:
		# Name of the current element in the list of elements
		i_name = Element.Name.GetValue(i).ToString()
		# Comparing prefix and name strings
		if prefix_old in i_name:
			# Adding element name to names list
			CeilingType_name.append(Element.Name.GetValue(i).ToString())
			# Adding element to filtered elenemts list
			CeilingType_filtered.append(i)
			
	for i in ContinuousRailType_all:
		i_name = Element.Name.GetValue(i).ToString()
		if prefix_old in i_name:
			ContinuousRailType_name.append(Element.Name.GetValue(i).ToString())
			ContinuousRailType_filtered.append(i)
			
	for i in RailingType_all:
		i_name = Element.Name.GetValue(i).ToString()
		if prefix_old in i_name:
			RailingType_name.append(Element.Name.GetValue(i).ToString())
			RailingType_filtered.append(i)
			
	for i in CurtainSystemType_all:
		i_name = Element.Name.GetValue(i).ToString()
		if prefix_old in i_name:
			CurtainSystemType_name.append(Element.Name.GetValue(i).ToString())
			CurtainSystemType_filtered.append(i)
			
	for i in RoofType_all:
		i_name = Element.Name.GetValue(i).ToString()
		if prefix_old in i_name:
			RoofType_name.append(Element.Name.GetValue(i).ToString())
			RoofType_filtered.append(i)
			
	for i in FasciaType_all:
		i_name = Element.Name.GetValue(i).ToString()
		if prefix_old in i_name:
			FasciaType_name.append(Element.Name.GetValue(i).ToString())
			FasciaType_filtered.append(i)
				
	for i in GutterType_all:
		i_name = Element.Name.GetValue(i).ToString()
		if prefix_old in i_name:
			GutterType_name.append(Element.Name.GetValue(i).ToString())
			GutterType_filtered.append(i)
			
	for i in GridType_all:
		i_name = Element.Name.GetValue(i).ToString()
		if prefix_old in i_name:
			GridType_name.append(Element.Name.GetValue(i).ToString())
			GridType_filtered.append(i)
			
	for i in LevelType_all:
		i_name = Element.Name.GetValue(i).ToString()
		if prefix_old in i_name:
			LevelType_name.append(Element.Name.GetValue(i).ToString())
			LevelType_filtered.append(i)
			
	for i in WallType_all:
		i_name = Element.Name.GetValue(i).ToString()
		if prefix_old in i_name:
			WallType_name.append(Element.Name.GetValue(i).ToString())
			WallType_filtered.append(i)
			
	for i in StairsType_all:
		i_name = Element.Name.GetValue(i).ToString()
		if prefix_old in i_name:
			StairsType_name.append(Element.Name.GetValue(i).ToString())
			StairsType_filtered.append(i)
			
	for i in StairsRunType_all:
		i_name = Element.Name.GetValue(i).ToString()
		if prefix_old in i_name:
			StairsRunType_name.append(Element.Name.GetValue(i).ToString())
			StairsRunType_filtered.append(i)
			
	for i in StairsLandingType_all:
		i_name = Element.Name.GetValue(i).ToString()
		if prefix_old in i_name:
			StairsLandingType_name.append(Element.Name.GetValue(i).ToString())
			StairsLandingType_filtered.append(i)
			
	for i in PanelType_all:
		i_name = Element.Name.GetValue(i).ToString()
		if prefix_old in i_name:
			PanelType_name.append(Element.Name.GetValue(i).ToString())
			PanelType_filtered.append(i)
			
	for i in WallFoundationType_all:
		i_name = Element.Name.GetValue(i).ToString()
		if prefix_old in i_name:
			WallFoundationType_name.append(Element.Name.GetValue(i).ToString())
			WallFoundationType_filtered.append(i)
			
# Joining lists
OUT = CeilingType_filtered + ContinuousRailType_filtered + RailingType_filtered + CurtainSystemType_filtered + RoofType_filtered + FasciaType_filtered + GutterType_filtered + GridType_filtered + LevelType_filtered + WallType_filtered + StairsType_filtered + StairsRunType_filtered + StairsLandingType_filtered + PanelType_filtered + WallFoundationType_filtered
# ----------------------------------------
name_5 = Element.Name(python_script_6)
replace_5 = String.Replace(str=name_5, searchFor=input, replaceWith=output)

# group: Annotate
python_script_7 = Python(IN[0]=input, IN[1]=output, IN[2]=annotate)
# ---------- python_script_7.python (65 lines) ----------
import clr
clr.AddReference('RevitServices')
import RevitServices
from RevitServices.Persistence import DocumentManager
from RevitServices.Transactions import TransactionManager

clr.AddReference('RevitAPI')

import Autodesk
from Autodesk.Revit.DB import *
from Autodesk.Revit.DB import FilteredElementCollector

doc = DocumentManager.Instance.CurrentDBDocument

prefix_old = IN[0]
prefix_new = IN[1]
conditions = IN[2]

# Collecting all elements of classes to a lists
DimensionType_all = FilteredElementCollector(doc).OfClass(DimensionType).ToElements()
SpotDimensionType_all = FilteredElementCollector(doc).OfClass(SpotDimensionType).ToElements()
FilledRegionType_all = FilteredElementCollector(doc).OfClass(FilledRegionType).ToElements()
TextNoteType_all = FilteredElementCollector(doc).OfClass(TextNoteType).ToElements()

# Creating empty lists for cycles (names, filtered elements)
DimensionType_name = []
DimensionType_filtered = []
SpotDimensionType_name = []
SpotDimensionType_filtered = []
FilledRegionType_name = []
FilledRegionType_filtered = []
TextNoteType_name = []
TextNoteType_filtered = []

if conditions:
	for i in DimensionType_all:
		# Name of the current element in the list of elements
		i_name = Element.Name.GetValue(i).ToString()
		# Comparing prefix and name strings
		if prefix_old in i_name:
			# Adding element name to names list
			DimensionType_name.append(Element.Name.GetValue(i).ToString())
			# Adding element to filtered elenemts list
			DimensionType_filtered.append(i)
			
	for i in SpotDimensionType_all:
		i_name = Element.Name.GetValue(i).ToString()
		if prefix_old in i_name:
			SpotDimensionType_name.append(Element.Name.GetValue(i).ToString())
			SpotDimensionType_filtered.append(i)
			
	for i in FilledRegionType_all:
		i_name = Element.Name.GetValue(i).ToString()
		if prefix_old in i_name:
			FilledRegionType_name.append(Element.Name.GetValue(i).ToString())
			FilledRegionType_filtered.append(i)
			
	for i in TextNoteType_all:
		i_name = Element.Name.GetValue(i).ToString()
		if prefix_old in i_name:
			TextNoteType_name.append(Element.Name.GetValue(i).ToString())
			TextNoteType_filtered.append(i)
		
# Joining lists
OUT = DimensionType_filtered + SpotDimensionType_filtered + FilledRegionType_filtered + TextNoteType_filtered
# ----------------------------------------
name_6 = Element.Name(python_script_7)
replace_6 = String.Replace(str=name_6, searchFor=input, replaceWith=output)

# group: Groups
python_script_8 = Python(IN[0]=input, IN[1]=output, IN[2]=groups)
# ---------- python_script_8.python (38 lines) ----------
import clr
clr.AddReference('RevitServices')
import RevitServices
from RevitServices.Persistence import DocumentManager
from RevitServices.Transactions import TransactionManager

clr.AddReference('RevitAPI')

import Autodesk
from Autodesk.Revit.DB import *
from Autodesk.Revit.DB import FilteredElementCollector

doc = DocumentManager.Instance.CurrentDBDocument

prefix_old = IN[0]
prefix_new = IN[1]
conditions = IN[2]

# Collecting all elements of classes to a lists
GroupType_all = FilteredElementCollector(doc).OfClass(GroupType).ToElements()

# Creating empty lists for cycles (names, filtered elements)
GroupType_name = []
GroupType_filtered = []

if conditions:
	for i in GroupType_all:
		# Name of the current element in the list of elements
		i_name = Element.Name.GetValue(i).ToString()
		# Comparing prefix and name strings
		if prefix_old in i_name:
			# Adding element name to names list
			GroupType_name.append(Element.Name.GetValue(i).ToString())
			# Adding element to filtered elenemts list
			GroupType_filtered.append(i)
		
# Joining lists
OUT = GroupType_filtered
# ----------------------------------------
name_7 = Element.Name(python_script_8)
replace_7 = String.Replace(str=name_7, searchFor=input, replaceWith=output)

# group: View
python_script_9 = Python(IN[0]=input, IN[1]=output, IN[2]=view)
# ---------- python_script_9.python (48 lines) ----------
import clr
clr.AddReference('RevitServices')
import RevitServices
from RevitServices.Persistence import DocumentManager
from RevitServices.Transactions import TransactionManager

clr.AddReference('RevitAPI')

import Autodesk
from Autodesk.Revit.DB import *
from Autodesk.Revit.DB import FilteredElementCollector

doc = DocumentManager.Instance.CurrentDBDocument

prefix_old = IN[0]
prefix_new = IN[1]
conditions = IN[2]

def filtering(views):
	v = []
	for i in views:
		# Name of the current element in the list of elements
		i_name = Element.Name.GetValue(i).ToString()
		# Comparing prefix and name strings
		if prefix_old in i_name:
			v.append(i)
	return v

# Collecting all elements of classes to a lists
ViewSchedule_all = FilteredElementCollector(doc).OfClass(ViewSchedule).ToElements()
ViewDrafting_all = FilteredElementCollector(doc).OfClass(ViewDrafting).ToElements()
ViewPlan_all = FilteredElementCollector(doc).OfClass(ViewPlan).ToElements()
ViewSection_all = FilteredElementCollector(doc).OfClass(ViewSection).ToElements()

# Creating empty lists for cycles (names, filtered elements)
View_name = []
View_filtered = []

if conditions:
	ViewSchedule_filtered = filtering(ViewSchedule_all)
	ViewDrafting_filtered = filtering(ViewDrafting_all)
	ViewPlan_filtered = filtering(ViewPlan_all)
	ViewSection_filtered = filtering(ViewSection_all)
	
	View_filtered = ViewSchedule_filtered + ViewDrafting_filtered + ViewPlan_filtered + ViewSection_filtered
		
#  Output
OUT = View_filtered
# ----------------------------------------
name_8 = Element.Name(python_script_9)
replace_8 = String.Replace(str=name_8, searchFor=input, replaceWith=output)

# group: Materials
python_script_10 = Python(IN[0]=input, IN[1]=output, IN[2]=materials)
# ---------- python_script_10.python (38 lines) ----------
import clr
clr.AddReference('RevitServices')
import RevitServices
from RevitServices.Persistence import DocumentManager
from RevitServices.Transactions import TransactionManager

clr.AddReference('RevitAPI')

import Autodesk
from Autodesk.Revit.DB import *
from Autodesk.Revit.DB import FilteredElementCollector

doc = DocumentManager.Instance.CurrentDBDocument

prefix_old = IN[0]
prefix_new = IN[1]
conditions = IN[2]

# Collecting all elements of classes to a lists
Material_all = FilteredElementCollector(doc).OfClass(Material).ToElements()

# Creating empty lists for cycles (names, filtered elements)
Material_name = []
Material_filtered = []

if conditions:
	for i in Material_all:
		# Name of the current element in the list of elements
		i_name = Element.Name.GetValue(i).ToString()
		# Comparing prefix and name strings
		if prefix_old in i_name:
			# Adding element name to names list
			Material_name.append(Element.Name.GetValue(i).ToString())
			# Adding element to filtered elenemts list
			Material_filtered.append(i)
		
# Joining lists
OUT = Material_filtered
# ----------------------------------------
name_9 = Element.Name(python_script_10)
replace_9 = String.Replace(str=name_9, searchFor=input, replaceWith=output)

list_join_elements = List.Join(python_script, python_script_2, python_script_3, python_script_4, python_script_5, python_script_6, python_script_7, python_script_8, python_script_9, python_script_10)
name_10 = Element.Name(python_script)
replace_10 = String.Replace(str=name_10, searchFor=input, replaceWith=output)
list_join_new_names = List.Join(replace_10, replace, replace_2, replace_3, replace_4, replace_5, replace_6, replace_7, replace_8, replace_9)
python_script_11 = Python(IN[0]=list_join_elements, IN[1]=list_join_new_names)
# ---------- python_script_11.python (26 lines) ----------
import clr
clr.AddReference('RevitServices')
import RevitServices
from RevitServices.Persistence import DocumentManager
from RevitServices.Transactions import TransactionManager

clr.AddReference('RevitAPI')

import Autodesk
from Autodesk.Revit.DB import *
from Autodesk.Revit.DB import FilteredElementCollector

doc = DocumentManager.Instance.CurrentDBDocument

families = UnwrapElement(IN[0])
names = IN[1]
number = len(families)

TransactionManager.Instance.EnsureInTransaction(doc)

for i in range(number):
	families[i].Name = names[i]
	
TransactionManager.Instance.TransactionTaskDone()
		
OUT = families
# ----------------------------------------
count = List.Count(python_script_11)
elements_changed = Watch(count)
