# Dynamo graph TG_Openings_Height_Autofill.dyn (Dynamo 1.3.4.6666)

digits_after_point = DoubleSlider(3, range=0..5 step 1)
parameter_name = StringInput("U.K.")
parameter_name_2 = StringInput("C.L.")
round_openings_to_the_bottom = BoolSelector(false)
python_script = Python(IN[0]=digits_after_point, IN[1]=parameter_name, IN[2]=parameter_name_2, IN[3]=round_openings_to_the_bottom)
# ---------- python_script.python (104 lines) ----------
import clr
clr.AddReference("RevitAPI")
from Autodesk.Revit.DB import *
clr.AddReference("RevitServices")
import RevitServices
from RevitServices.Persistence import DocumentManager
from RevitServices.Transactions import TransactionManager

doc = DocumentManager.Instance.CurrentDBDocument


digits = int(IN[0])
parameter_name = IN[1]
parameter_2_name = IN[2]
bottom = IN[3]


generic = FilteredElementCollector(doc).OfCategory(BuiltInCategory.OST_MechanicalEquipment).WhereElementIsNotElementType().ToElements()
openings = []
openings_round = []
for i in generic:
	family_parameter = i.LookupParameter("Family")
	family = family_parameter.AsValueString()
	if "TG_Open_Rectangular" in family:
		openings.append(i)
	if "TG_Open_Round" in family:
		openings_round.append(i)

shared_bp = FilteredElementCollector(doc).OfCategory(BuiltInCategory.OST_SharedBasePoint).WhereElementIsNotElementType().ToElements()[0]
shared_bp_elev_parameter = shared_bp.LookupParameter("Elev")
shared_bp_elev = float(shared_bp_elev_parameter.AsValueString())

shared_bp_height = shared_bp.get_BoundingBox(None).Min.Z

TransactionManager.Instance.EnsureInTransaction(doc)

count = 0
for opening in openings:
	try:
		parameter = opening.LookupParameter(parameter_name)
		
		height = opening.Location.Point.Z
		
		#offset_parameter = opening.LookupParameter("Offset")
		#offset = offset_parameter.AsValueString()
		
		elevation = round(((height - shared_bp_height) * 30.48 + 0.3) / 100, digits)
		
		parameter.Set(str(elevation))
		
		#offset_parameter.Set(0)
		
		count += 1
	except:
		pass
for opening in openings_round:
	try:
		parameter = opening.LookupParameter(parameter_2_name)
		
		if bottom:
			height = opening.Location.Point.Z
		else:
			diameter_parameter = opening.Symbol.LookupParameter("Diameter of Sleeve")
			diameter = diameter_parameter.AsDouble()
			height = opening.Location.Point.Z + diameter / 2
		
		#offset_parameter = opening.LookupParameter("Offset")
		#offset = offset_parameter.AsValueString()
		
		elevation = round(((height - shared_bp_height) * 30.48) / 100, digits)
		
		parameter.Set(str(elevation))
		
		#offset_parameter.Set(0)
		
		count += 1
	except:
		pass

if shared_bp_height == shared_bp_elev:
	shared_bp_error = ""
else: 
	shared_bp_error = "\nSurvey point: internal height is not the same as elevation!"

"""
loc = XYZ(0,0,0)
f = openings[0].Symbol
a = doc.Create.NewFamilyInstance(loc, f, Structure.StructuralType.NonStructural)
"""

TransactionManager.Instance.TransactionTaskDone()

OUT = "Parameter set in " + str(count) + " instances" + shared_bp_error

"""
1. Выбор элементов категории "Generic Model".
2. Фильтрация по имени семейства "TG_Open_Rectangular" или "TG_Open_Round".
3. Выбор Shared Base Point проекта и его параметра Elev.
4. Для всех TG_Open_Rectangular параметр U.K. принимает значение возвышения над Shared Base Point в метрах.
	* Геометрия семейства на 0.3 см ниже чем его расчетный U.K.
5. Для всех TG_Open_Round параметр C.L. принимает значение возвышения над Shared Base Point в метрах.
	* Геометрия семейства на радиус ниже чем его расчетный C.L.
6. Проверка на одной ли высоте фактическая высота Shared Base Point и его Elev.
"""
# ----------------------------------------
result = Watch(python_script)
