# Dynamo graph TG_ScopeBox_Align.dyn (Dynamo 1.3.4.6666)

select_scope_box = DSModelElementSelection()
select_line = DSModelElementSelection()
restart = BoolSelector(false)
python_script = Python(IN[0]=select_scope_box, IN[1]=select_line, IN[2]=restart)
# ---------- python_script.python (53 lines) ----------
import clr
clr.AddReference("RevitNodes")
clr.AddReference("RevitServices")
import RevitServices
from RevitServices.Persistence import DocumentManager
from RevitServices.Transactions import TransactionManager

clr.AddReference("RevitAPI")
import Autodesk
from Autodesk.Revit.DB import *

from math import cos, acos, degrees, pi

doc = DocumentManager.Instance.CurrentDBDocument
uidoc = DocumentManager.Instance.CurrentUIApplication.ActiveUIDocument
view = doc.ActiveView

opt = Options()

box = UnwrapElement(IN[0])
line = UnwrapElement(IN[1])

box_geom = box.get_Geometry(opt)
box_lines = [x.Direction for x in box_geom]
box_line = box_lines[1]
box_line_angle = acos(box_line.X)
if box_line.Y < 0:
	box_line_angle = 2 * pi - box_line_angle

line_dir = line.Location.Curve.Direction
line_dir_angle = acos(line_dir.X)
if line_dir.X < 0:
	line_dir_angle = 2 * pi - line_dir_angle

angle = line_dir_angle - box_line_angle # !!!!! NEED TO BE FIXED
if angle > pi:
	angle -= pi
angle_string = str(degrees(angle))[:5]

axis_x = (box.get_BoundingBox(view).Min.X + box.get_BoundingBox(view).Max.X) / 2
axis_y = (box.get_BoundingBox(view).Min.Y + box.get_BoundingBox(view).Max.Y) / 2
axis_p_1 = XYZ(axis_x, axis_y, 0)
axis_p_2 = XYZ(axis_x, axis_y, 1000)
axis = Line.CreateBound(axis_p_1, axis_p_2)

TransactionManager.Instance.EnsureInTransaction(doc)
	
box.Location.Rotate(axis, angle)

TransactionManager.Instance.TransactionTaskDone()


OUT = "Scope Box rotated on " + angle_string + " degrees."
# ----------------------------------------
result = Watch(python_script)
