# Dynamo graph TG_Stairs_Steps_Enumerate.dyn (Dynamo 1.3.4.6666)

start_number = DoubleInput(1)
right_side = BoolSelector(true)
python_script = Python(IN[0]=start_number, IN[1]=right_side)
# ---------- python_script.python (150 lines) ----------
import clr

# Import RevitAPI
clr.AddReference("RevitAPI")
import Autodesk
from Autodesk.Revit.DB import *
from Autodesk.Revit.DB.Architecture import *
import System

clr.AddReference("ProtoGeometry")
from Autodesk.DesignScript import Geometry as geom

# Import Element wrapper extension methods
clr.AddReference("RevitNodes")
import Revit
from Autodesk.Revit.DB import *

# Import ToProtoType, ToRevitType geometry conversion extension methods
clr.ImportExtensions(Revit.GeometryConversion)

clr.AddReference("RevitAPIUI")
from Autodesk.Revit.UI.Selection import ObjectType

clr.AddReference("ProtoGeometry")
from Autodesk.DesignScript import Geometry as geom

# Import DocumentManager and TransactionManager
clr.AddReference("RevitServices")
import RevitServices
from RevitServices.Persistence import DocumentManager
from RevitServices.Transactions import TransactionManager

doc = DocumentManager.Instance.CurrentDBDocument
view_id = doc.ActiveView.Id


def select_category(doc, view_id, category):
	elements = FilteredElementCollector(doc, view_id).OfCategory(category).ToElements()
	return elements

risers_below = int(IN[0])
side = IN[1]

#  Selecting all multistairs in the view
stairs_ms_all = select_category(doc, view_id, BuiltInCategory.OST_MultistoryStairs)

count = 0
grouped = 0
unpinned = 0
# pinned = 0

#  Filtering for multistairs that are in groups
stairs_ms = []
for i in stairs_ms_all:
	if i.GroupId == ElementId.InvalidElementId:
		stairs_ms.append(i)
	else:
		grouped += 1

#  Selecting all levels in the view
levels_all = FilteredElementCollector(doc).OfCategory(BuiltInCategory.OST_Levels).ToElementIds()

#  Unpinning groups (stairs) in multistairs

for stair_ms in range(len(stairs_ms)):
	for l in range(len(levels_all)):
		TransactionManager.Instance.EnsureInTransaction(doc)
		try:
			stairs_ms[stair_ms].Unpin(levels_all[l])
			unpinned += 1
		except:
			pass
		TransactionManager.Instance.TransactionTaskDone()
"""
for stair_ms in range(len(stairs_ms)):
	for l in range(len(levels_all)):
		if stairs_ms[stair_ms].Pinned:
			pinned += 1
"""
runs = select_category(doc, view_id, BuiltInCategory.OST_StairsRuns)


TransactionManager.Instance.EnsureInTransaction(doc)

#  Selecting all stairs in the view
stairs_all = select_category(doc, view_id, BuiltInCategory.OST_Stairs)

#  Filtering for stairs that are in groups
stairs_temp = []
test = []
for i in stairs_all:
	test.append(i.GroupId)
	if i.GroupId == ElementId.InvalidElementId:
		stairs_temp.append(i)
	else:
		grouped += 1

#  Creating list of stairs levels and filtering for Model-In-Place
stairs = []
levels = []
for stair in range(len(stairs_temp)):
	try:
		levels.append(stairs_temp[stair].BaseElevation)
		stairs.append(stairs_temp[stair])
	except:
		pass

#  Changing stairs order in a list according to base height
zipped = zip(levels, stairs)
stairs = [x for _, x in sorted(zipped)]

#  Changing thread numbers
for stair in range(len(stairs)):
	parameter = stairs[stair].get_Parameter(BuiltInParameter.STAIRS_TRISER_NUMBER_BASE_INDEX)
	parameter.Set(risers_below)
	risers_below += stairs[stair].ActualRisersNumber

#  Creating thread numbers on the view
for run in range(len(runs)):
	if side:
		reference = runs[run].GetNumberSystemReference(StairsNumberSystemReferenceOption.RightQuarter)
	else:
		reference = runs[run].GetNumberSystemReference(StairsNumberSystemReferenceOption.LeftQuarter)
	run_id = Autodesk.Revit.DB.LinkElementId(runs[run].Id)
	
	try:
		NumberSystem.Create(doc, view_id, run_id, reference)
		count += 1
	except:
		count += 1
	
TransactionManager.Instance.TransactionTaskDone()

text = ""
if grouped:
	text += str(grouped)
	text +=	" stairs are in groups! Exclude them from groups! "
text += str(count)
text += " runs with "
text += str(risers_below - 1)
text += " treads was numerated. "
if unpinned:
	text += str(unpinned)
	text += " stairs was unpinned!"
"""
if pinned:
	text += str(pinned)
	text += " stairs are pinned!"
"""
OUT = text
# ----------------------------------------
result = Watch(python_script)
