# Dynamo graph TG_Walls_Comparison.dyn (Dynamo 2.6.1.8786)

select_filled_region_type = FilledRegionTypes("Solid Pink")  # graph input
links_count = DoubleSlider(2, range=1..2 step 1)  # graph input
material_name = StringInput("גבס")  # graph input
boolean = BoolSelector(true)
python_script = Python(IN[0]=select_filled_region_type, IN[1]=links_count, IN[2]=material_name, IN[3]=boolean)
# ---------- python_script.python (172 lines) ----------
import clr
clr.AddReference('ProtoGeometry')
from Autodesk.DesignScript.Geometry import *
clr.AddReference("RevitAPI")
from Autodesk.Revit.DB import *
clr.AddReference("RevitServices")
import RevitServices
from RevitServices.Persistence import DocumentManager
from RevitServices.Transactions import TransactionManager

clr.AddReference("RevitNodes")
import Revit
clr.ImportExtensions(Revit.Elements)
clr.ImportExtensions(Revit.GeometryConversion)

doc = DocumentManager.Instance.CurrentDBDocument
active_view = doc.ActiveView
elevation = active_view.GenLevel.Elevation


filled_region_type = UnwrapElement(IN[0]).Id
links_count = IN[1]
mat_name = IN[2]


opt = Options()


def GetWallsLoops(wall):
	opt = Options()
	loops = []
	geom_elem = wall.get_Geometry(opt)
	for geom_solid in geom_elem:
		for face in geom_solid.Faces:
			try:
				if face.FaceNormal.Z == -1: #!!! (1)
					h = face.Origin.Z
					#  Get the lowest face
					if not loops:
						loops = face.GetEdgesAsCurveLoops()
						h_lowest = h
					else:
						if h < h_lowest:
							loops = face.GetEdgesAsCurveLoops()
							h_lowest = h
			except AttributeError:
				pass
	return loops
	
def GetWallsLoop(loops):
	temp_booleaned = []
	for i in loops:
		try:
			temp_extrusion = GeometryCreationUtilities.CreateExtrusionGeometry(i, XYZ(0,0,1), 10)
		except:
			pass
		if temp_booleaned:
			b = BooleanOperationsUtils.ExecuteBooleanOperation(temp_extrusion, temp_booleaned, BooleanOperationsType.Union)
			temp_booleaned = b
		else:
			temp_booleaned = temp_extrusion
	return temp_booleaned

#  Get links
links = FilteredElementCollector(doc, active_view.Id).OfCategory(BuiltInCategory.OST_RvtLinks).ToElements()
try:
	link_0 = links[0].GetLinkDocument()
except ValueError:
	pass
try:
	link_1 = links[1].GetLinkDocument()
except ValueError:
	pass

#  Selecting all walls from 1 doc on the view
walls_0_all = FilteredElementCollector(link_0).OfCategory(BuiltInCategory.OST_Walls).WhereElementIsNotElementType()
levels_0_all = FilteredElementCollector(link_0).OfCategory(BuiltInCategory.OST_Levels).WhereElementIsNotElementType().ToElements()
level_0 = levels_0_all[0].Elevation
for i in levels_0_all:
	if abs(i.ProjectElevation - elevation) < 1:
		level_0 = i.ProjectElevation

if links_count == 1:
	walls_1_all = FilteredElementCollector(doc, active_view.Id).OfCategory(BuiltInCategory.OST_Walls).WhereElementIsNotElementType().ToElements()
else:
	walls_1_all = FilteredElementCollector(link_1).OfCategory(BuiltInCategory.OST_Walls).WhereElementIsNotElementType()
	levels_1_all = FilteredElementCollector(link_1).OfCategory(BuiltInCategory.OST_Levels).WhereElementIsNotElementType().ToElements()
	level_1 = levels_1_all[0].Elevation
	for i in levels_1_all:
		if abs(i.ProjectElevation - elevation) < 1:
			level_1 = i.Elevation


#  Filtering needed walls for materials and height (for links)
walls_0 = []
test = []
for i in walls_0_all:
	try:
		mats = i.WallType.GetCompoundStructure().GetLayers()
		mats_id = [m.MaterialId for m in mats]
		mats_name = []
		for j in mats_id:
			mats_name.append(link_0.GetElement(j).Name)
			test.append(mats_name)
		if mat_name in mats_name:
			diff_0 = abs(i.Location.Curve.Origin.Z - level_0)
			test.append(i.Location.Curve.Origin.Z)
			if diff_0 < 1:
				walls_0.append(i)
	except AttributeError:
		pass
walls_1 = []
for i in walls_1_all:
	try:
		mats = i.WallType.GetCompoundStructure().GetLayers()
		mats_id = [m.MaterialId for m in mats]
		mats_name = []
		for j in mats_id:
			if links_count == 1:
				mats_name.append(doc.GetElement(j).Name)
			else:
				mats_name.append(link_1.GetElement(j).Name)
		if mat_name in mats_name:
			if links_count == 1:
				diff_1 = abs(i.Location.Curve.Origin.Z - level_0)
			else:
				diff_1 = abs(i.Location.Curve.Origin.Z - level_1)
			if diff_1 < 1:
				walls_1.append(i)
	except:
		pass


#  Getting plan loops of walls
loops_0 = [GetWallsLoops(i) for i in walls_0 if GetWallsLoops(i)]
loops_1 = [GetWallsLoops(i) for i in walls_1 if GetWallsLoops(i)]

#  Getting plan loops of wall sets
loop_0 = GetWallsLoop(loops_0)
loop_1 = GetWallsLoop(loops_1)

if loop_0 and loop_1:
	bool = BooleanOperationsUtils.ExecuteBooleanOperation(loop_0, loop_1, BooleanOperationsType.Intersect)
	
	#  Create CurveLoop from intersection
	loop = []
	for face in bool.Faces:
		try:
			if face.FaceNormal.Z == 1:
				loop.append(face.GetEdgesAsCurveLoops())
		except AttributeError:
			pass
	
	
	TransactionManager.Instance.EnsureInTransaction(doc)
	
	#  Drawing filled region
	count = 0
	for i in loop:
		region = FilledRegion.Create(doc, filled_region_type, active_view.Id, i)
		count += 1
	
	
	TransactionManager.Instance.TransactionTaskDone()
	
	
	OUT = str (count) + " filled regions created."

else:
	OUT = "No intersections found."

#OUT = loops_1
# ----------------------------------------
result = Watch(python_script)
python_script_2 = Python(IN[0]=select_filled_region_type, IN[1]=links_count, IN[2]=material_name, IN[3]=boolean)  # frozen
# ---------- python_script_2.python (179 lines) ----------
import clr
clr.AddReference('ProtoGeometry')
from Autodesk.DesignScript.Geometry import *
clr.AddReference("RevitAPI")
from Autodesk.Revit.DB import *
clr.AddReference("RevitServices")
import RevitServices
from RevitServices.Persistence import DocumentManager
from RevitServices.Transactions import TransactionManager

clr.AddReference("RevitNodes")
import Revit
clr.ImportExtensions(Revit.Elements)
clr.ImportExtensions(Revit.GeometryConversion)

doc = DocumentManager.Instance.CurrentDBDocument
active_view = doc.ActiveView
elevation = active_view.GenLevel.Elevation


filled_region_type = UnwrapElement(IN[0]).Id
links_count = IN[1]
mat_name = IN[2]


opt = Options()


def GetWallsLoops(wall):
	opt = Options()
	loops = []
	geom_elem = wall.get_Geometry(opt)
	for geom_solid in geom_elem:
		for face in geom_solid.Faces:
			try:
				if face.FaceNormal.Z == 1:
					loops = face.GetEdgesAsCurveLoops()
			except AttributeError:
				pass
	return loops
	
def GetWallsLoop(loops):
	temp_booleaned = []
	for i in loops:
		temp_extrusion = GeometryCreationUtilities.CreateExtrusionGeometry(i, XYZ(0,0,1), 10)
		if temp_booleaned:
			b = BooleanOperationsUtils.ExecuteBooleanOperation(temp_extrusion, temp_booleaned, BooleanOperationsType.Union)
			temp_booleaned = b
		else:
			temp_booleaned = temp_extrusion
	"""
	#  Create CurveLoop from total extrusion
	loop = []
	for face in temp_booleaned.Faces:
		try:
			if face.FaceNormal.Z == 1:
				loop = face.GetEdgesAsCurveLoops()
		except AttributeError:
			pass
	return loop
	"""
	return temp_booleaned
	
def GetIntersection(l_0, l_1):
	temp_extrusion_0 = GeometryCreationUtilities.CreateExtrusionGeometry(l_0, XYZ(0,0,1), 10)
	temp_extrusion_1 = GeometryCreationUtilities.CreateExtrusionGeometry(l_1, XYZ(0,0,1), 10)
	bool = BooleanOperationsUtils.ExecuteBooleanOperation(temp_extrusion_0, temp_extrusion_1, BooleanOperationsType.Intersect)
	
	#  Create CurveLoop from intersection
	l = []
	for face in bool.Faces:
		try:
			if face.FaceNormal.Z == 1:
				l = face.GetEdgesAsCurveLoops()
		except AttributeError:
			pass
	return l

#  Get links
links = FilteredElementCollector(doc, active_view.Id).OfCategory(BuiltInCategory.OST_RvtLinks).ToElements()
try:
	link_0 = links[0].GetLinkDocument()
	link_1 = links[1].GetLinkDocument()
except ValueError:
	pass


#  Selecting all walls from 1 doc on the view
walls_0_all = FilteredElementCollector(link_0).OfCategory(BuiltInCategory.OST_Walls).WhereElementIsNotElementType()
if links_count == 1:
	walls_1_all = FilteredElementCollector(doc, active_view.Id).OfCategory(BuiltInCategory.OST_Walls).WhereElementIsNotElementType().ToElements()
else:
	walls_1_all = FilteredElementCollector(link_1).OfCategory(BuiltInCategory.OST_Walls).WhereElementIsNotElementType()


#  Filtering needed walls for materials
walls_0 = []
for i in walls_0_all:
	try:
		mats = i.WallType.GetCompoundStructure().GetLayers()
		mats_id = [m.MaterialId for m in mats]
		mats_name = []
		for j in mats_id:
			mats_name.append(link_0.GetElement(j).Name)
		if mat_name in mats_name:
			walls_0.append(i)
	except:
		pass
walls_1 = []
for i in walls_1_all:
	try:
		mats = i.WallType.GetCompoundStructure().GetLayers()
		mats_id = [m.MaterialId for m in mats]
		mats_name = []
		for j in mats_id:
			if links_count == 1:
				mats_name.append(doc.GetElement(j).Name)
			else:
				mats_name.append(link_1.GetElement(j).Name)
		if mat_name in mats_name:
			walls_1.append(i)
	except:
		pass


#  Getting plan loops of walls
loops_0 = [GetWallsLoops(i) for i in walls_0 if GetWallsLoops(i)]
loops_1 = [GetWallsLoops(i) for i in walls_1 if GetWallsLoops(i)]

#  Getting plan loops of wall sets
loop_0 = GetWallsLoop(loops_0)
loop_1 = GetWallsLoop(loops_1)
"""
temp_booleaned = []
test = 0
loop_0 = []
loop_1 = []
for i in loops_0:
	temp_extrusion = GeometryCreationUtilities.CreateExtrusionGeometry(i, XYZ(0,0,1), 10)
	if loop_0:
		b = BooleanOperationsUtils.ExecuteBooleanOperation(temp_extrusion, loop_0, BooleanOperationsType.Union)
		loop_0 = b
	else:
		loop_0 = temp_extrusion

for i in loops_1:
	temp_extrusion = GeometryCreationUtilities.CreateExtrusionGeometry(i, XYZ(0,0,1), 10)
	if loop_1:
		b = BooleanOperationsUtils.ExecuteBooleanOperation(temp_extrusion, loop_1, BooleanOperationsType.Union)
		loop_1 = b
	else:
		loop_1 = temp_extrusion
#  Getting intersections
loop = GetIntersection(loop_0, loop_1)
"""


bool = BooleanOperationsUtils.ExecuteBooleanOperation(loop_0, loop_1, BooleanOperationsType.Intersect)

#  Create CurveLoop from intersection
loop = []
for face in bool.Faces:
	try:
		if face.FaceNormal.Z == 1:
			loop.append(face.GetEdgesAsCurveLoops())
	except AttributeError:
		pass


TransactionManager.Instance.EnsureInTransaction(doc)

#  Drawing filled region
for i in loop:
	region = FilledRegion.Create(doc, filled_region_type, active_view.Id, i)


TransactionManager.Instance.TransactionTaskDone()

OUT = region
# ----------------------------------------
