# Dynamo graph TG_Walls_Section_Dimension_TEST.dyn (Dynamo 1.3.4.6666)

restart = BoolSelector(true)
python_script = Python(IN[0]=restart)
# ---------- python_script.python (121 lines) ----------
import clr

# Import RevitAPI
clr.AddReference("RevitAPI")
from Autodesk.Revit.DB import *

clr.AddReference("RevitAPIUI")
from Autodesk.Revit.UI.Selection import ISelectionFilter
from Autodesk.Revit.UI.Selection import ObjectType

clr.AddReference("ProtoGeometry")
from Autodesk.DesignScript import Geometry as geom

# Import DocumentManager and TransactionManager
clr.AddReference("RevitServices")
import RevitServices
from RevitServices.Persistence import DocumentManager
from RevitServices.Transactions import TransactionManager

from System.Collections.Generic import List

doc = DocumentManager.Instance.CurrentDBDocument
uidoc = DocumentManager.Instance.CurrentUIApplication.ActiveUIDocument
view = doc.ActiveView

#  Selection filter for category
class SelectionFilter(ISelectionFilter):
    def __init__(self, category_name):
        self.category_name = category_name
    def AllowElement(self, e):
        if e.Category.Name == self.category_name:
            return True
        else:
            return False

opts = Options()
opts.ComputeReferences = True
opts.IncludeNonVisibleObjects = False
opts.View = view

#  Select line by user
line_ref = uidoc.Selection.PickObject(ObjectType.Element, SelectionFilter("Lines"), "Select Line")
line = doc.GetElement(line_ref)
curve = line.GeometryCurve

#  Select all floors in the view
walls = FilteredElementCollector(doc, doc.ActiveView.Id).OfClass(Wall).ToElements()

#  List for intersection points
intersections = []
#  Some conversion
ira = clr.StrongBox[IntersectionResultArray](IntersectionResultArray())
#  Iterate through floors solids and get faces
intersection_faces = []

test = []

trans = Transaction(doc, "Temp Parts")
trans.Start()

for w in walls:
	wall_ids_i = List[ElementId]([w.Id])
	try:
		wall_parts = PartUtils.CreateParts(doc, wall_ids_i)
		p = PartUtils.GetAssociatedParts(doc, w.Id, True, True)
		for i in wall_parts:
			par = i.GetParameters("Construction").AsString()
			test.append(par)
			if par == "Core":
				for obj in i.get_Geometry(opts):
					if isinstance(obj, Solid):
						faces = obj.Faces
						for face in faces:
							#  Some faces are cylidrical so catch exception on FaceNormal
							try:
								intersection = face.Intersect(curve, ira)
								if intersection == SetComparisonResult.Overlap:
									point = ira.get_Item(0).XYZPoint
									#  Collecting unique intersection points
									intersections.append(face.Reference)
									#  Collecting faces for spot elevations
									intersection_faces.append(face)
							except:
								pass
	except:
		wall_ids_i = []
		pass
	wall_ids_i = []

trans.Commit()        					

#  Convert lists to ReferenceArray
count = 0
references = ReferenceArray()
try:
	references.Append(intersections[0])
	count += 1
except:
	pass
for i in intersections:
	if i not in references:
		references.Append(i)
		count += 1
if count:
	count -= 1
	
count_spots = 0
spots_move = []
#  Start transaction
TransactionManager.Instance.EnsureInTransaction(doc)
#  Create dimensions
try:
	dim = doc.Create.NewDimension(view, curve, references)
except:
	pass
#  Finish transaction    
TransactionManager.Instance.TransactionTaskDone()

#  Output
OUT = "Dimension with " + str(count) + " segments was created."
OUT = test
# ----------------------------------------
result = Watch(python_script)
